# Dynamo graph Auto_Zone_Fill_Inside_Multiple_Tray_EW.dyn (Dynamo 2.6.2.15705)
# packages: GenerativeDesign.Revit 1.3.1

select_multiple_model_elements = DSModelElementMutlipleSelection()  # 3 picked in the model; graph input
getLocation = Element.GetLocation(element=select_multiple_model_elements)
family_types = FamilyTypes("Cable_Routing_Zone:Cable_Routing_Zone")
geometry = Element.Geometry(element=select_multiple_model_elements)
centroid = Solid.Centroid(solid=geometry)
byPoint = FamilyInstance.ByPoint(familyType=family_types, point=centroid)
code_block = CodeBlock { 90; }
setRotation = FamilyInstance.SetRotation(familyInstance=byPoint, degree=code_block)
string = StringInput("L")
string_2 = StringInput("Width")
getParameterValueByName = Element.GetParameterValueByName(element=select_multiple_model_elements, parameterName=string_2)
setParameterByName = Element.SetParameterByName(element=setRotation, parameterName=string, value=getParameterValueByName)
string_3 = StringInput("H")
string_4 = StringInput("Height")
getParameterValueByName_2 = Element.GetParameterValueByName(element=select_multiple_model_elements, parameterName=string_4)
setParameterByName_2 = Element.SetParameterByName(element=setRotation, parameterName=string_3, value=getParameterValueByName_2)
string_5 = StringInput("W")
string_6 = StringInput("Length")
getParameterValueByName_3 = Element.GetParameterValueByName(element=select_multiple_model_elements, parameterName=string_6)
setParameterByName_3 = Element.SetParameterByName(element=setRotation, parameterName=string_5, value=getParameterValueByName_3)
round = Math.Round(number=getParameterValueByName_3)
code_block_2 = CodeBlock(number=round) { x = number/2; }
