# Dynamo graph Auto_Zone_Fill_Inside_Single_Tray.dyn "Auto_Zone_Fill_Inside_Multiple_Tray" (Dynamo 2.6.2.15705)

select_model_element = DSModelElementSelection()  # nothing selected
getLocation = Element.GetLocation(element=select_model_element)
family_types = FamilyTypes("Cable_Routing_Zone:Cable_Routing_Zone")
geometry = Element.Geometry(element=select_model_element)
centroid = Solid.Centroid(solid=geometry)
byPoint = FamilyInstance.ByPoint(familyType=family_types, point=centroid)
string = StringInput("L")
string_2 = StringInput("Width")
getParameterValueByName = Element.GetParameterValueByName(element=select_model_element, parameterName=string_2)
setParameterByName = Element.SetParameterByName(element=byPoint, parameterName=string, value=getParameterValueByName)
string_3 = StringInput("H")
string_4 = StringInput("Height")
getParameterValueByName_2 = Element.GetParameterValueByName(element=select_model_element, parameterName=string_4)
setParameterByName_2 = Element.SetParameterByName(element=byPoint, parameterName=string_3, value=getParameterValueByName_2)
string_5 = StringInput("W")
string_6 = StringInput("Length")
getParameterValueByName_3 = Element.GetParameterValueByName(element=select_model_element, parameterName=string_6)
setParameterByName_3 = Element.SetParameterByName(element=byPoint, parameterName=string_5, value=getParameterValueByName_3)
setParameterByName_4 = Element.SetParameterByName()  # unwired: element, parameterName, value
round = Math.Round(number=getParameterValueByName_3)
code_block = CodeBlock(number=round) { x = number/2; }
